# Grasshopper definition Groundhog - Flows Examples.ghx (Grasshopper 1.0.4)
# plug-ins: Groundhog

# ----
# Definition prepared for Groundhog v0.6.1a and depends on components from that plugin. It is available for download at http://groundhog.la/
# 
# Contact groundhog@philipbelesky.com for support or feedback.
# 
# This is an example file related to the plugin's documentation.
# 
# This definition is licensed under the terms of the GPL v3 https://opensource.org/licenses/GPL-3.0
# Example 1 (Lower-Left)
number_slider = Slider(20, range=0..50)
multithread = BooleanToggle(False)

# ----
# Example 2 (Upper-Right)
proximity_threshold = Slider(50, range=0..100)
random_points_count = Slider(200, range=0..1000)
multithread_2 = BooleanToggle(False)

# ---- group: Base Surface
# Groundhog Example File
srf = Surface(<surface referenced from the Rhino model>)

# ---- group: Base Mesh
mesh = Mesh(<mesh referenced from the Rhino model>)

# ---- group: Create point grid for path starts
sdivide = DivideSurface(Surface=srf, UCount=number_slider, VCount=Slider(20, range=0..50))  # -> flatten(Points), Normals, Parameters

# ---- group: Distribute points randomly on mesh for path starts
cluster = Cluster(C=mesh, N=random_points_count)

# ---- group: Calculate the flow paths (for mesh)
mesh_flows = FlowSimulationMesh(Mesh=mesh, Points=cluster, Fidelity=100, Thread=multithread_2)  # -> FlowPoints, FlowPaths

# ---- group: Calculate the flow paths (for surface)
srf_flows = FlowSimulationSurface(Surface=srf, Points=sdivide.Points, Fidelity=Slider(25, range=0..100), Thread=multithread)  # -> FlowPoints, FlowPaths

# ---- group: Calculate catchment bounds
catchments = FlowCatchments(FlowPaths=srf_flows.FlowPaths, ProximtyThreshold=Slider(50, range=0..100))  # -> Catchments, FlowPaths, ColorCodes

catchments_2 = FlowCatchments(FlowPaths=mesh_flows.FlowPaths, ProximtyThreshold=proximity_threshold)  # -> Catchments, FlowPaths, ColorCodes

# ---- group: Color flow paths by length from source
explode = Explode(Curve=catchments.FlowPaths, Recursive=True)  # -> Segments, Vertices
minimum_luminance = Slider(0.7, range=0..1)
luminance_step = Slider(-0.02, range=-1..0.1)
lng = ListLength(List=explode.Segments)
series = Series(Start=1, Step=luminance_step, Count=lng)
max = Maximum(A=series, B=minimum_luminance)
hsl = ColourHSL(Alpha=1, Hue=0, Saturation=0, Luminance=max)
preview = CustomPreview(Geometry=explode.Segments, Shader=hsl)

# ---- group: Create and color a naïve flooding extents from end points
sampling_accuracy = Slider(10, range=0..1000)
pooling_radius = Slider(750, range=0..1000)
end = EndPoints(Curve=mesh_flows.FlowPaths)  # -> Start, End
pdecon = Deconstruct(Point=end.End)  # -> XComponent, YComponent, ZComponent
pt = ConstructPoint(XCoordinate=pdecon.XComponent, YCoordinate=pdecon.YComponent, ZCoordinate=0)
lng_2 = ListLength(List=pt)
repeat = RepeatData(Data=pooling_radius, Length=lng_2)
metaball_t = MetaBallTCustom(Points=pt, Charge=repeat, Plane=PlaneXY(0, 0, 0), Threshold=0.5, Accuracy=sampling_accuracy)
boundary = BoundarySurfaces(Edges=metaball_t)
preview_2 = CustomPreview(Geometry=boundary, Shader=ColourSwatch(SwatchColor=RGB(130, 130, 130)))

# ---- group: Color code catchment boundaries
preview_3 = CustomPreview(Geometry=catchments.Catchments, Shader=catchments.ColorCodes)

# ---- group: Color code flow paths by catchment
preview_4 = CustomPreview(Geometry=catchments_2.FlowPaths, Shader=catchments_2.ColorCodes)

# ==== cluster Cluster
N = ClusterInput()
C = ClusterInput()
bbox = BoundingBox(Content=C, Plane=PlaneXY(0, 0, 0))  # -> Box, Box_2
debrep = DeconstructBrep(Brep=bbox.Box)  # -> Faces, Edges, Vertices
item = ListItem(List=debrep.Faces, Index=Slider(5, range=0..10), Wrap=True)
pop2d = Populate2D(Region=item, Count=N, Seed=1)
project = ProjectPoint(Point=pop2d, Direction=Vector(0, 0, -1), Geometry=C)  # -> Point, Index
P = ClusterOutput(project.Point)
