# Grasshopper definition Groundhog - Terrain Examples.ghx (Grasshopper 1.0.4)
# plug-ins: Groundhog

# Groundhog Example File
# Definition prepared for Groundhog v0.6.1a and depends on components from that plugin. It is available for download at http://groundhog.la/
# 
# Contact groundhog@philipbelesky.com for support or feedback.
# 
# This is an example .3dm file related to the plugin's documentation.
# 
# This definition is licensed under the terms of the GPL v3 https://opensource.org/licenses/GPL-3.0
base_contour_curves = Curve([<curve referenced from the Rhino model> x69])

# ---- group: Convert contours to a mesh
control_points = ControlPoints(Curve=base_contour_curves)  # -> Points, Weights, Knots
remove_overlapping = RemoveOverlapping(pt=flatten(control_points.Points))
delaunay_mesh = DelaunayMesh(Points=remove_overlapping, Plane=PlaneXY(0, 0, 0))

# ---- group: Calculate grade from mesh faces
mesh_slope = MeshSlope(Mesh=delaunay_mesh)  # -> MeshFaces, FaceCenters, FaceSlopeVectors, FaceSlopeAngles

# ---- group: Visualise grade angle
face_centers = Point(mesh_slope.FaceCenters)
text_vector_color = ColourSwatch(SwatchColor=RGB(255, 0, 255))
face_vectors = Vector(mesh_slope.FaceSlopeVectors)
vector_length = Slider(1000, range=0..1000)
multiplication = Multiplication(A=face_vectors, B=vector_length)
angles_vectors = VectorDisplayEx(Point=face_centers, Vector=multiplication, Colour=text_vector_color, Width=1)

# ---- group: Visualise grade as fill
angles = Integer(mesh_slope.FaceSlopeAngles)
mesh = Mesh(mesh_slope.MeshFaces)
bounds = Bounds(Numbers=angles)
gradient = Gradient(LowerLimit=0, UpperLimit=bounds, Parameter=angles, stops=[0: RGB(255, 255, 255), 1: RGB(0, 0, 0)])
mesh_colours = MeshColours(Mesh=simplify(graft(mesh)), Colours=simplify(graft(gradient)))

# ---- group: Label grade angle
face_centers_2 = Point(mesh_slope.FaceCenters)
text_size = Slider(500, range=0..1000)
text_vector_color_2 = ColourSwatch(SwatchColor=RGB(0, 255, 255))
face_angles = Integer(mesh_slope.FaceSlopeAngles)
angles_labels = TextTag3D(Location=face_centers_2, Text=face_angles, Size=text_size, Colour=text_vector_color_2, Justification=5)

# ==== cluster RemoveOverlapping
pt = ClusterInput()
pt_2 = Point(pt)
sort_pt = SortPoints(Points=pt_2)  # -> Points, Indices
shift = ShiftList(List=sort_pt.Points, Shift=1, Wrap=True)
pdecon = Deconstruct(Point=sort_pt.Points)  # -> XComponent, YComponent, ZComponent
pdecon_2 = Deconstruct(Point=shift)  # -> XComponent, YComponent, ZComponent
equals = Equality(FirstNumber=pdecon.YComponent, SecondNumber=pdecon_2.YComponent)  # -> Equality, Inequality
equals_2 = Equality(FirstNumber=pdecon.XComponent, SecondNumber=pdecon_2.XComponent)  # -> Equality, Inequality
and = GateAnd(A=equals_2.Equality, B=equals.Equality)
equals_3 = Equality(FirstNumber=and, SecondNumber=0)  # -> Equality, Inequality
cull = CullPattern(List=sort_pt.Points, CullPattern=equals_3.Equality)
pt_3 = Point(cull)
pt_4 = ClusterOutput(pt_3)
